% Simulink data dictionary UAM_data.sldd

SensorAAFiltNum = 4386000
SensorAAFiltDen = [1 2960 4386000]

UAVPathManagerBus = Simulink.Bus()
  mode: uint8
  position: double[3 1]
  params: double[4 1]

StateBus = Simulink.Bus()
  course: double
  gndspeed: double
  airspeed: double
  Xe: double[3 1]
  Ve: double[3 1]
  DCMbe: double[3 3]
  q: double[1 4]
  pqr: double[3 1]
  Vb: double[1 3]
  Abb: double[1 3]
  Abe: double[1 3]
  Euler: double[3 1]
  RotorParameters: double
  ypr: double[3 1]
  Ve_ground: double[3 1]

RotorParameters = Simulink.Bus()
  w1: double
  w2: double
  w3: double
  w4: double
  c1: double
  c2: double

flightState = enum(DefaultValue="Hover")
  Hover = 0
  Transition = 1
  FixedWing = 2
  BackTransition = 3

FSState = flightState.Hover
R_WAYPOINTTRANSITION = 1
R_LOOKAHEAD = 5
control = struct(L1=30, cruiseSpeed=15, turningRadius=50, takeoffNavAlt=20, minThrottle=0.1, maxThrottle=1)

AAC = Simulink.Bus()
  airspeed: double
  altitude: double
  course: double
  L1: double
  climbrate: double

FWControl = struct(transitionRadius=10)

doubleUavPathManager = Simulink.Bus()
  mode: uint8
  position: double[3 1]
  params: double[4 1]

HoverMission = struct(mode=uint8(0), position=[0; 0; 0], params=[0; 0; 0; 0])
UAVSampleTime = 0.02
TransitionMission = [struct(mode=1, position=[0; 0; 0], params=[0; 0; 0; 0]), struct(mode=2, position=[0; 0; -20], params=[0; 0; 0; 0]), struct(mode=2, position=[20; 0; -20], params=[0; 0; 0; 0]), struct(mode=6, position=[1; 1; 1], params=[1; 1; 1; 1]), struct(mode=2, position=[100; 0; -20], params=[0; 0; 0; 0]), struct(mode=3, position=[100; 200; -20], params=[50; -1; 0.5; 0]), struct(mode=6, position=[-1; -1; -1], params=[-1; -1; -1; -1]), struct(mode=2, position=[300; 300; -20], params=[0; 0; 0; 0]), struct(mode=4, position=[300; 300; 0], params=[0; 0; 0; 0])]
Vt = 10
zGround = 0

FixedWingCommandBus = Simulink.Bus()
  roll: double
  pitch: double
  yaw: double
  airspeed: double

controlMode = Simulink.Bus()
  lateralGuidance: uint8
  airspeedAltitude: uint8
  attitude: uint8
  manual: uint8
  armed: uint8
  inTransition: uint8
  TransitionCondition: uint8

GuidanceStates = Simulink.Bus()
  Euler: double[3]
  pqr: double[3]
  Ve: double[3]
  Xe: double[3]
  course: double
  Tilt: double

HoverSPBus = Simulink.Bus()
  X: double
  Y: double
  Z: double
  Yaw: double

innerLoopCmdsBus = Simulink.Bus()
  LAP: double[3 1]
  HeadingCmd: double
  YawCmd: double

FlightModeType = enum(DefaultValue="Manual")
  Manual = 0
  Auto = 1
  Emergecny = 2

sensorData = Simulink.Bus()
  GPSCourse: double
  gndspeed: double
  DiffPress: double
  rho: double
  LLA: double[1 3]
  Abb: double[1 3]
  Gyro: double[1 3]
  Mag: double[1 3]
  GPSVelocity: double[1 3]
  Abe: double[1 3]
  RotorParameters: double

ReferenceFilterNum = 0.04877
ReferenceFilterDen = [1 -0.9512]

controlParams = struct(
  P_ROLL_RATE=2.589,
  D_ROLL_RATE=0.0166,
  N_ROLL_RATE=100,
  P_PITCH_RATE=4.4,
  D_PITCH_RATE=0.0217,
  N_PITCH_RATE=100,
  P_YAW_RATE=1.77,
  D_YAW_RATE=0,
  N_YAW_RATE=100,
  P_ROLL=8.79,
  P_PITCH=8.79,
  P_YAW=1,
  P_VX=1,
  D_VX=0,
  N_VX=1.0705,
  P_VY=0.2,
  D_VY=0.5518,
  N_VY=1.0705,
  P_VZ=5,
  D_VZ=0,
  N_VZ=8.4215,
  P_X=-0.5,
  P_Y=-1.03,
  P_Z=-1.97,
  P_BACK=0.1)

ControlSampleTime = 0.005

FWControlParams = struct(
  P_CLIMBRATE=0.1,
  P_ALT=0.4,
  P_AIRSPD=10,
  I_AIRSPD=0,
  D_AIRSPD=0,
  N_AIRSPD=100,
  P_FW_ROLL=2,
  P_FW_PITCH=10,
  I_FW_PITCH=0,
  D_FW_PITCH=2.1893,
  N_FW_PITCH=100,
  P_FW_ROLLRATI=0.4,
  I_FW_ROLLRATI=0.8,
  P_FW_PITCHRA=0.15,
  P_FW_YAWRATI=0.01)